vi "index.gviweb"   [G Web Development Software 22.0.0]
panel controls:
  "stop": bool
  "Start": bool
panel indicators:
  "URL Image": string
  "Nivå (%)": f64
  "URL Image_2": string
  "LED": bool
  "URL Image_3": string
  "endring": f64
  "Nivå (%)": f64
  "URL Image_4": string
  "Power Button": bool
  "HH": bool
diagram:
  $Start <- FALSE
  # Place setup code before the loop. For example, perform initial data communication and wire the results into the loop.
  while {
    # Top-Level WebVIs usually contain a While Loop that never stops so that they can continue running as long as the web page is open in the user's web browser.
    case ($Start) {
      frame False, Default { }
      frame True {
        s1 = 0  # shift register
        while {
          Add(s1, $endring) -> w1
          $"Nivå (%)" <- w1
          $"Nivå (%)" <- w1
          Is Less(x=w1, y=95) -> w2
          $"Power Button" <- w2
          $LED <- w2
          $HH <- w2
          Select(s=w2, t=5, f=0) -> w3
          $endring <- w3
          Wait(time to wait=500)
          next s1 = w1
          stop if $stop
        }
      }
    }
    $"Nivå (%)" <- 0
    $endring <- 10
    stop if FALSE
  }
